# Grasshopper definition gear2.gh (Grasshopper 0.9.76)

number_slider = Slider(1.5, range=0..10)
number_slider_2 = Slider(25, range=0..100)
number_slider_3 = Slider(0.95, range=0..1)
point = Point(<point referenced from the Rhino model>)
point_2 = Point(<point referenced from the Rhino model>)
point_3 = Point(<point referenced from the Rhino model>)
cluster = Cluster(count=number_slider_2, plane=point_3, radius=number_slider, B=number_slider_3)
cluster_2 = Cluster(count=number_slider_2, plane=point, radius=number_slider, B=number_slider_3)
cluster_3 = Cluster(count=number_slider_2, plane=point_2, radius=number_slider, B=number_slider_3)
merge = Merge(Data1=cluster, Data2=cluster_3, Data3=cluster_2)
curve = Curve(merge)

# ==== cluster Cluster
B = ClusterInput()
radius = ClusterInput()
multiplication = Multiplication(A=radius, B=B)
division = Division(A=Slider(1, range=0..1), B=B)
plane = ClusterInput()
multiplication_2 = Multiplication(A=radius, B=division)
circle = Circle(Plane=plane, Radius=multiplication_2)
circle_2 = Circle(Plane=plane, Radius=radius)
circle_3 = Circle(Plane=plane, Radius=multiplication)
count = ClusterInput()
divide_curve = DivideCurve(Curve=circle, Count=count, Kinks=False)  # -> Points, Tangents, Parameters
divide_curve_2 = DivideCurve(Curve=circle_3, Count=count, Kinks=False)  # -> Points, Tangents, Parameters
divide_curve_3 = DivideCurve(Curve=circle_2, Count=count, Kinks=False)  # -> Points, Tangents, Parameters
shift_list = ShiftList(List=divide_curve_2.Points, Shift=1, Wrap=True)
line = Line(StartPoint=divide_curve_2.Points, EndPoint=divide_curve.Points)
line_2 = Line(StartPoint=shift_list, EndPoint=divide_curve.Points)
merge = Merge(Data1=line, Data2=line_2)  # -> flatten(Result)
join_curves = JoinCurves(Curves=merge, Preserve=False)
curves = ClusterOutput(join_curves)
