# Grasshopper definition triangle.gh (Grasshopper 1.0.4)

pt = Point(Point(0, 0, 0))
triangle = Triangle(num_2=Slider(36.7, range=0..100), num=Slider(65.7, range=0..100), num_3=Slider(49, range=0..100), G=pt)  # -> C, L
number_slider = Slider(3.53, range=0..5)
crv = Curve(<curve referenced from the Rhino model>)
pt_2 = Point(Point(43.11906214, 0, 0))
cluster = Cluster(P=pt_2, R=Slider(41.5, range=0..100), R_2=Slider(50, range=0..100), A=number_slider, C=crv, i=Slider(0, range=0..100))  # -> L_2, L
cluster_2 = Cluster(P=pt_2, R=Slider(39.3, range=0..100), R_2=Slider(61.9, range=0..100), A=number_slider, C=crv, i=Slider(1, range=0..1))  # -> L_2, L
crv_2 = Curve(cluster.L_2)
crv_3 = Curve(cluster_2.L_2)
end = EndPoints(Curve=crv_2)  # -> Start, End
end_2 = EndPoints(Curve=crv_3)  # -> Start, End
pt_3 = Point(end_2.End)
triangle_2 = Triangle(num_2=Slider(41.5, range=0..100), num=Slider(40.1, range=0..100), num_3=Slider(55.8, range=0..100), G=end.End)  # -> C, L
angle = Angle(VectorA=triangle_2.L, VectorB=crv_2)  # -> Angle, Reflex
rotate = Rotate(Geometry=triangle_2.C, Angle=angle.Angle, Plane=end.End)  # -> Geometry, Transform
rotate_2 = Rotate(Geometry=rotate.Geometry, Angle=degrees(Slider(90, range=0..100)), Plane=end.End)  # -> Geometry, Transform

# ==== cluster Triangle
num = ClusterInput()
num_2 = ClusterInput()
num_3 = ClusterInput()
G = ClusterInput()
num_4 = Number(num)
num_5 = Number(num_3)
num_6 = Number(num_2)
X = UnitX(Factor=num_4)
X_2 = UnitX(Factor=num_6)
get_angle = Get_angle(x=num_6, y=num_4, z=num_5)
move = Move(Geometry=G, Motion=X)  # -> Geometry, Transform
move_2 = Move(Geometry=G, Motion=X_2)  # -> Geometry, Transform
ln = Line(StartPoint=G, EndPoint=move_2.Geometry)
ln_2 = Line(StartPoint=G, EndPoint=move.Geometry)
rotate = Rotate(Geometry=ln, Angle=degrees(get_angle), Plane=G)  # -> Geometry, Transform
end = EndPoints(Curve=rotate.Geometry)  # -> Start, End
ln_3 = Line(StartPoint=move.Geometry, EndPoint=end.End)
L = ClusterOutput(ln)
merge = Merge(Data1=ln_3, Data2=ln_2, Data3=rotate.Geometry)
join = JoinCurves(Curves=merge, Preserve=False)
C = ClusterOutput(join)

# ==== cluster Cluster
A = ClusterInput()
C = ClusterInput()
mod = Modulus(A=A, B=Slider(1, range=0..1))
P = ClusterInput()
R = ClusterInput()
R_2 = ClusterInput()
eval = EvaluateCurve(Curve=reparameterize(C), Parameter=mod)  # -> Point, Tangent, Angle
cir = Circle(Plane=P, Radius=R)
i = ClusterInput()
cir_2 = Circle(Plane=eval.Point, Radius=R_2)
ccx = CurveCurve(CurveA=cir, CurveB=cir_2)  # -> Points, ParamsA, ParamsB
item = ListItem(List=ccx.Points, Index=i, Wrap=True)
ln = Line(StartPoint=P, EndPoint=item)
ln_2 = Line(StartPoint=eval.Point, EndPoint=item)
L = ClusterOutput(ln_2)
L_2 = ClusterOutput(ln)

# ==== cluster Get_angle
x = ClusterInput()
y = ClusterInput()
z = ClusterInput()
expression = Expression(x=x, y=y, z=z, Expression="(x²+y²-z²) / (2 * x * y)")
pi = Pi(Factor=1)
acos = ArcCosine(Value=expression)
division = Division(A=acos, B=pi)
multiplication = Multiplication(A=division, B=Slider(180, range=0..1000))
R = ClusterOutput(multiplication)
