# Grasshopper definition zigzag.gh (Grasshopper 1.0.4)

crv = Curve(<curve referenced from the Rhino model>)
Y = UnitY(Factor=Slider(0.03, range=0..0.1))
neg = Negative(Value=Y)
cluster = Cluster(C=crv, A=Slider(20, range=0..100), x=neg)
crv_2 = Curve(cluster)

# ==== cluster Cluster
A = ClusterInput()
C = ClusterInput()
multiplication = Multiplication(A=A, B=Slider(2, range=0..10))
x = ClusterInput()
divide = DivideCurve(Curve=C, Count=multiplication, Kinks=False)  # -> Points, Tangents, Parameters
neg = Negative(Value=x)
dispatch = Dispatch(List=divide.Points, DispatchPattern=[True, False])  # -> ListA, ListB
move = Move(Geometry=dispatch.ListB, Motion=neg)  # -> Geometry, Transform
entwine = Entwine(Branch00=dispatch.ListA, Branch01=move.Geometry, FlattenInputs=True)
flip = FlipMatrix(Data=entwine)  # -> flatten(Data)
clean = CleanTree(RemoveNulls=True, RemoveInvalid=True, RemoveEmpty=False, Tree=flip)
intcrv = Interpolate(Vertices=clean, Degree=3, Periodic=False, KnotStyle=1)  # -> Curve, Length, Domain
C_2 = ClusterOutput(intcrv.Curve)
