# Grasshopper definition gear.gh (Grasshopper 0.9.76)

xy_plane = XYPlane(Origin=Point(0, 0, 0))
point = Point(<point referenced from the Rhino model>)
vector = Vector(xy_plane)
plane = Plane(xy_plane)
circle_cnr = CircleCNR(Center=point, Normal=plane, Radius=Slider(3, range=0..10))
spoke_gear = Spoke_gear(center=point, radius=Slider(3, range=0..10), normal=vector, B=Slider(0.9, range=0..1), count=Slider(32, range=0..100))  # -> extrusion_2, extrusion
gear1 = Gear1(curve=circle_cnr, count=Slider(21, range=0..100))
brep = Brep([spoke_gear.extrusion_2, spoke_gear.extrusion])

# ==== cluster Gear1
curve = ClusterInput()
count = ClusterInput()
divide_curve = DivideCurve(Curve=curve, Count=count, Kinks=False)  # -> Points, Tangents, Parameters
move = Move(Geometry=divide_curve.Tangents, Motion=divide_curve.Points)  # -> Geometry, Transform
shift_list = ShiftList(List=move.Geometry, Shift=Slider(-1, range=-1..0), Wrap=True)
line = Line(StartPoint=divide_curve.Points, EndPoint=shift_list)
number_slider = Slider(0.1, range=0..0.1)
end_points = EndPoints(Curve=line)  # -> Start, End
panel = Panel(""".9
.1""")
panel_2 = Panel(""".9
.1""")
cluster = Cluster(list=end_points.End, shift=Slider(-1, range=-1..0), weights=panel)
cluster_2 = Cluster(list=end_points.End, shift=Slider(1, range=0..1), weights=panel)
cluster_3 = Cluster(list=divide_curve.Points, shift=Slider(-1, range=-1..0), weights=panel_2)
cluster_4 = Cluster(list=divide_curve.Points, shift=Slider(1, range=0..1), weights=panel_2)
line_2 = Line(StartPoint=cluster, EndPoint=cluster_2)
line_3 = Line(StartPoint=cluster_2, EndPoint=cluster_4)
line_4 = Line(StartPoint=cluster, EndPoint=cluster_3)
merge = Merge(Data1=line_2, Data2=line_4, Data3=line_3)
join_curves = JoinCurves(Curves=merge, Preserve=False)
curves = ClusterOutput(join_curves)

# ==== cluster Spoke_gear
B = ClusterInput()
normal = ClusterInput()
center = ClusterInput()
radius = ClusterInput()
multiplication = Multiplication(A=radius, B=B)
circle_cnr = CircleCNR(Center=center, Normal=normal, Radius=radius)
circle_cnr_2 = CircleCNR(Center=center, Normal=normal, Radius=multiplication)
count = ClusterInput()
divide_curve = DivideCurve(Curve=circle_cnr_2, Count=count, Kinks=False)  # -> Points, Tangents, Parameters
circle_cnr_3 = CircleCNR(Center=divide_curve.Points, Normal=normal, Radius=Slider(0.1, range=0..1))
multiplication_2 = Multiplication(A=normal, B=Slider(2, range=0..10))
boundary_surfaces = BoundarySurfaces(Edges=circle_cnr_3)
merge = Merge(Data1=circle_cnr, Data2=circle_cnr_3)  # -> flatten(Result)
extrude = Extrude(Base=boundary_surfaces, Direction=multiplication_2)
boundary_surfaces_2 = BoundarySurfaces(Edges=merge)
multiplication_3 = Multiplication(A=normal, B=Slider(0.25, range=0..1))
extrusion = ClusterOutput(extrude)
extrude_2 = Extrude(Base=boundary_surfaces_2, Direction=multiplication_3)
extrusion_2 = ClusterOutput(extrude_2)

# ==== cluster Cluster
list = ClusterInput()
shift = ClusterInput()
shift_list = ShiftList(List=list, Shift=shift, Wrap=True)
entwine = Entwine(Branch00=list, Branch01=shift_list, FlattenInputs=True)  # -> simplify(Result)
flip_matrix = FlipMatrix(Data=entwine)
weights = ClusterInput()
weighted_average = WeightedAverage(Input=flip_matrix, Weights=weights)  # -> flatten(ArithmeticMean)
arithmetic_mean = ClusterOutput(weighted_average)
