# Grasshopper definition gear2.gh (Grasshopper 0.9.76)
# plug-ins: Python Interpreter

number_slider = Slider(50, range=0..100)
number_slider_2 = Slider(1.5, range=0..10)
number_slider_3 = Slider(0.96, range=0..1)

curve = Curve(<curve referenced from the Rhino model>)
number_slider_4 = Slider(100, range=0..100)
point = Point(<point referenced from the Rhino model>)
point_2 = Point(<point referenced from the Rhino model>)
curve_2 = Curve(<curve referenced from the Rhino model>)

number_slider_5 = Slider(1.5, range=0..10)
number_slider_6 = Slider(25, range=0..100)
number_slider_7 = Slider(0.95, range=0..1)
point_3 = Point(<point referenced from the Rhino model>)
point_4 = Point(<point referenced from the Rhino model>)
point_5 = Point(<point referenced from the Rhino model>)
sawtooth = Sawtooth(count=number_slider_6, A=number_slider_5, B=number_slider_7, plane=point_3)
sawtooth_2 = Sawtooth(count=number_slider_6, A=number_slider_5, B=number_slider_7, plane=point_5)
sawtooth_3 = Sawtooth(count=number_slider_6, A=number_slider_5, B=number_slider_7, plane=point_4)
merge = Merge(Data1=sawtooth_2, Data2=sawtooth, Data3=sawtooth_3)
curve_3 = Curve(merge)

point_6 = Point(<point referenced from the Rhino model>)
area = Area(Geometry=curve)  # -> Area, Centroid
pi = Pi(Factor=1)
pointed = Pointed(count=number_slider, A=number_slider_2, B=number_slider_3, plane=point)
pointed_2 = Pointed(count=number_slider, A=number_slider_2, B=number_slider_3, plane=point_2)
pointed_3 = Pointed(count=number_slider, A=number_slider_2, B=number_slider_3, plane=point_6)
division = Division(A=area.Area, B=pi)
addition = Addition(A=Slider(1, range=0..1), B=number_slider_4)

number_slider_8 = Slider(11, range=0..100)
rotate = Rotate(Geometry=pointed_2, Angle=degrees(number_slider_8), Plane=point_2)  # -> Geometry, Transform
rotate_2 = Rotate(Geometry=pointed_3, Angle=degrees(number_slider_8), Plane=point_6)  # -> Geometry, Transform

square_root = SquareRoot(Value=division)
multiplication = Multiplication(A=square_root, B=Slider(2, range=0..10))

number_slider_9 = Slider(97, range=0..360)
negative = Negative(Value=number_slider_9)
rotate_3 = Rotate(Geometry=pointed, Angle=negative, Plane=point)  # -> Geometry, Transform
rotate_4 = Rotate(Geometry=rotate.Geometry, Angle=number_slider_9, Plane=point_2)  # -> Geometry, Transform
rotate_5 = Rotate(Geometry=rotate_2.Geometry, Angle=number_slider_9, Plane=point_6)  # -> Geometry, Transform

divide_curve = DivideCurve(Curve=curve, Count=addition, Kinks=False)  # -> Points, Tangents, Parameters
divide_curve_2 = DivideCurve(Curve=curve_2, Count=number_slider_4, Kinks=False)  # -> Points, Tangents, Parameters
python_script = PythonScript(x=divide_curve.Points, y=divide_curve_2.Points, z=multiplication)  # -> out, a; inputs x: list, y: list
# ---------- python_script: Python ----------
import rhinoscriptsyntax

a = []

print(len(y))
#p2x = [rhinoscriptsyntax.GetPoint(e) for e in y]

for point in x:
    #p1 = rhinoscriptsyntax.GetPoint(point)
    p1 = point
    distances = [rhinoscriptsyntax.Distance(p1, p2) for p2 in y]
    adjusted_distances = [abs(z-e) for e in distances]
    min_distance = min(adjusted_distances)
    index = adjusted_distances.index(min_distance)
    a.append(y[index])

print(a)
# ---------- end python_script ----------
line = Line(StartPoint=divide_curve.Points, EndPoint=python_script.a)
merge_2 = Merge(Data1=rotate_3.Geometry, Data2=rotate_4.Geometry, Data3=rotate_5.Geometry)
group = Group(Objects=line)
curve_4 = Curve(merge_2)

# ==== cluster Sawtooth

B = ClusterInput()
A = ClusterInput()
division = Division(A=Slider(1, range=0..1), B=B)
multiplication = Multiplication(A=A, B=B)
multiplication_2 = Multiplication(A=A, B=division)

plane = ClusterInput()
count = ClusterInput()
circle = Circle(Plane=plane, Radius=multiplication_2)
circle_2 = Circle(Plane=plane, Radius=multiplication)
divide_curve = DivideCurve(Curve=reparameterize(circle_2), Count=count, Kinks=False)  # -> Points, Tangents, Parameters
divide_curve_2 = DivideCurve(Curve=circle, Count=count, Kinks=False)  # -> Points, Tangents, Parameters
shift_list = ShiftList(List=divide_curve.Points, Shift=1, Wrap=True)
line = Line(StartPoint=shift_list, EndPoint=divide_curve_2.Points)
line_2 = Line(StartPoint=divide_curve.Points, EndPoint=divide_curve_2.Points)
merge = Merge(Data1=line_2, Data2=line)  # -> flatten(Result)
join_curves = JoinCurves(Curves=merge, Preserve=False)
curves = ClusterOutput(join_curves)

# ==== cluster Pointed

B = ClusterInput()
A = ClusterInput()
division = Division(A=Slider(1, range=0..1), B=B)
multiplication = Multiplication(A=A, B=B)
multiplication_2 = Multiplication(A=A, B=division)

plane = ClusterInput()
count = ClusterInput()
circle = Circle(Plane=plane, Radius=multiplication_2)
circle_2 = Circle(Plane=plane, Radius=multiplication)
division_2 = Division(A=Slider(360, range=0..1000), B=count)
divide_curve = DivideCurve(Curve=circle, Count=count, Kinks=False)  # -> Points, Tangents, Parameters
divide_curve_2 = DivideCurve(Curve=reparameterize(circle_2), Count=count, Kinks=False)  # -> Points, Tangents, Parameters
division_3 = Division(A=division_2, B=Slider(2, range=0..10))
shift_list = ShiftList(List=divide_curve_2.Points, Shift=1, Wrap=True)
rotate = Rotate(Geometry=divide_curve.Points, Angle=degrees(division_3), Plane=plane)  # -> Geometry, Transform
line = Line(StartPoint=shift_list, EndPoint=rotate.Geometry)
line_2 = Line(StartPoint=divide_curve_2.Points, EndPoint=rotate.Geometry)
merge = Merge(Data1=line_2, Data2=line)  # -> flatten(Result)
join_curves = JoinCurves(Curves=merge, Preserve=False)
curves = ClusterOutput(join_curves)
