# Grasshopper definition geneva.gh (Grasshopper 0.9.76)

point = Point(Point(0, 0, 0))
number_slider = Slider(4, range=0..10)
circle = Circle(Plane=point, Radius=Slider(2, range=0..10))
circle_2 = Circle(Plane=point, Radius=Slider(7, range=0..10))
divide_curve = DivideCurve(Curve=circle, Count=number_slider, Kinks=False)  # -> Points, Tangents, Parameters
divide_curve_2 = DivideCurve(Curve=circle_2, Count=number_slider, Kinks=False)  # -> Points, Tangents, Parameters
shift_list = ShiftList(List=divide_curve_2.Points, Shift=1, Wrap=True)
line = Line(StartPoint=divide_curve.Points, EndPoint=divide_curve_2.Points)
rotate = Rotate(Geometry=line, Angle=degrees(Slider(90, range=0..100)), Plane=point)  # -> Geometry, Transform
line_2 = Line(StartPoint=divide_curve_2.Points, EndPoint=shift_list)
unit_vector = UnitVector(Vector=rotate.Geometry)
multiplication = Multiplication(A=unit_vector, B=Slider(0.25, range=0..1))
negative = Negative(Value=multiplication)
move = Move(Geometry=line, Motion=multiplication)  # -> Geometry, Transform
move_2 = Move(Geometry=line, Motion=negative)  # -> Geometry, Transform
end_points = EndPoints(Curve=move.Geometry)  # -> Start, End
end_points_2 = EndPoints(Curve=move_2.Geometry)  # -> Start, End
line_3 = Line(StartPoint=end_points.Start, EndPoint=end_points_2.Start)
