# Grasshopper definition snail.gh (Grasshopper 0.9.76)

point = Point(Point(2.5, 4, 0))
shell_drop_cam = Shell_drop_cam(plane=point, radius=Slider(0.75, range=0..1), A=Slider(2, range=0..10))
curve = Curve(shell_drop_cam)

# ==== cluster Shell_drop_cam
number_slider = Slider(9, range=0..10)
plane = ClusterInput()
radius = ClusterInput()
addition = Addition(A=number_slider, B=Slider(1, range=0..1))
circle = Circle(Plane=plane, Radius=radius)
A = ClusterInput()
divide_curve = DivideCurve(Curve=circle, Count=number_slider, Kinks=False)  # -> Points, Tangents, Parameters
division = Division(A=A, B=number_slider)
list_item = ListItem(List=divide_curve.Points, Index=0, Wrap=True)
series = Series(Start=0, Step=division, Count=addition)
merge = Merge(Data1=divide_curve.Points, Data2=list_item)  # -> flatten(Result)
addition_2 = Addition(A=series, B=Slider(1, range=0..1))
scale = Scale(Geometry=merge, Center=plane, Factor=addition_2)  # -> Geometry, Transform
interpolate = Interpolate(Vertices=scale.Geometry, Degree=3, Periodic=False, KnotStyle=1)  # -> Curve, Length, Domain
list_item_2 = ListItem(List=scale.Geometry, Index=Slider(-1, range=-1..0), Wrap=True)
line = Line(StartPoint=list_item, EndPoint=list_item_2)
merge_2 = Merge(Data1=line, Data2=interpolate.Curve)
join_curves = JoinCurves(Curves=merge_2, Preserve=False)
curves = ClusterOutput(join_curves)
